# Grasshopper definition grass_hopper_demo_text_extrude.gh (Grasshopper 1.0.7)
# plug-ins: Text2GeomViaIrit2Grasshopper

text = Text("Hello from Rhino!")
font_style = Text("Times New Roman")
Z = UnitZ(Factor=1)
text2geom = Text2GeomViaIrit2Grasshopper(
    FontName=font_style,
    FontSize=Slider(43, range=0..100),
    FontStyle=Slider(3, range=0..3),
    TextSpacing=Slider(0, range=0..100),
    OutputType=Slider(1, range=0..1),
    Text=text)
multiplication = Multiplication(A=Z, B=Slider(1, range=1..50))
extr = Extrude(Base=text2geom, Direction=multiplication)
cap = CapHoles(Brep=extr)
