# Grasshopper definition sphere_example.gh (Grasshopper 1.0.8)
# plug-ins: CreateSphereGrasshopper

createsphere = CreateSphereGrasshopper(X=Slider(0, range=0..1), Y=Slider(0, range=0..1), Z=Slider(0, range=0..1), Radius=Slider(40.667, range=0..100))
